# Grasshopper definition Karamba_modell_to_ifc.gh (Grasshopper 1.0.7)
# plug-ins: Bifocals, karambaGH

negative = Negative(Value=Slider(1, range=0..10))
# Beam fixed on one side and vertically supported on the other
line = Line(Line((0, 0, 6), (14, 0, 6)))
unit_z = UnitZ(Factor=negative)
supp = SupportKaramba(PosInd="0", menu=[buttons(on, on, on, on, on, on)])
supp_2 = SupportKaramba(PosInd="1", menu=[buttons(off, off, on, off, off, off)])
linetobeam = LineToBeamKaramba(Line=line, Color=ColourSwatch(SwatchColor=RGB(193, 173, 196)), New=True, Remove=True, LimitDistance_m=0.005)  # -> Element, Points, Info

# ---- group: Loads (Karamba3D)
loads = LoadsKaramba3D(Vector=unit_z, LCase=0, mode="Uniform Line", menu=[buttons(on, off, off)])

# ----
support = SupportKaramba([supp, supp_2])
panel = Panel(linetobeam.Element)
assemble = AssembleModelKaramba(Elem=linetobeam.Element, Support=support, Load=loads, LDist=0.005)  # -> Model, Info, Mass, CenterOfGravity
panel_2 = Panel(loads)
panel_3 = Panel(assemble.Model)

# ---- group: Analyze (Karamba3D)
analyzethi = AnalyzeKaramba3D(Model=assemble.Model)  # -> CalculatedModel, MaximumDisplacement_cm, ResultingForceOfGravity_kN, ElasticEnergy_kNm

# ----
panel_4 = Panel(assemble.Info)
panel_5 = Panel(analyzethi.MaximumDisplacement_cm)
modelview = ModelViewKaramba(Model=analyzethi.CalculatedModel, LoadCaseFactorsForLinearSuperposition=1, IndexOfVisibleLoadcase=-1)  # -> Model, DeformedMesh, DeformedAxes, DeformedModel
export_model_to_dstv_karamba3d = ExportModelToDStVKaramba3D(
    Model=analyzethi.CalculatedModel,
    Path="C:\Users\PewPe\OneDrive\Skrivebord\test2.ifc",
    menu=[buttons(on, off, off, off, off)])  # -> DStV, Info
# IFC-fil
# !
panel_6 = Panel(export_model_to_dstv_karamba3d.DStV)
beamview = BeamViewKaramba(Model=modelview.Model)  # -> Model, MeshesOfRenderedBeams, DeformedBeamAxes, LegendColors, LegendTags
panel_7 = Panel(panel_5)
ghpython_script = GhPythonScript(model=panel_6, correctDisplacement=panel_7)  # -> out, FilteredData, CorrectDisplacement
# ---------- ghpython_script: Python ----------
__author__ = "Desktop"
__version__ = "2021.01.19"

import rhinoscriptsyntax as rs
def find_between_r( s, first, last ):
    try:
        start = s.rindex( first ) + len( first )
        end = s.rindex( last, start )
        return s[start:end]
    except ValueError:
        return ""

FilteredData = find_between_r(model, "DATA;", "ENDSEC;") 
CorrectDisplacement = correctDisplacement
# ---------- end ghpython_script ----------
panel_8 = Panel(ghpython_script.FilteredData)
