# Grasshopper definition data_generator_4_var.gh (Grasshopper 1.0.7)
# plug-ins: karambaGH, Write2csv

# ----
# Seeds
number_slider = Slider(5, range=0..70)

number_slider_2 = Slider(20, range=0..100000)
dom = ConstructDomain(DomainStart=Slider(5, range=0..10), DomainEnd=Slider(10, range=0..10))
random = Random(Range=dom, Number=number_slider_2, Seed=number_slider)
X = UnitX(Factor=random)
dom_2 = ConstructDomain(DomainStart=Slider(10, range=0..100), DomainEnd=Slider(40, range=0..100))
series = Series(Start=0, Step=Slider(0, range=0..100), Count=number_slider_2)
move = Move(Geometry="0,0,0", Motion=X)  # -> Geometry, Transform
matselect = MaterialSelectionKaramba3D(menu=[dropdown(1), dropdown(4)])
pt = ConstructPoint(XCoordinate=series, YCoordinate=series, ZCoordinate=series)
random_2 = Random(Range=dom_2, Number=number_slider_2, Seed=Slider(4, range=0..70))
ln = Line(StartPoint="0,0,0", EndPoint=move.Geometry)  # -> graft(Line)
dom_3 = ConstructDomain(DomainStart=Slider(10, range=5..50), DomainEnd=Slider(20, range=5..50))
cross_section = CrossSectionKaramba3D(
    FamilyNameOfCrossSection="DefaultCroSec",
    Material=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,
    Height_cm=random_2,
    UpperFlangeWidth_cm=random_2,
    LowerFlangeWidth_cm=random_2,
    mode="Trapezoid")  # -> graft(CrossSection)
random_3 = Random(Range=dom_3, Number=number_slider_2, Seed=Slider(3, range=0..70))
Z = UnitZ(Factor=random_3)
neg = Negative(Value=Z)
supp = SupportKaramba3D(PosInd=pt, menu=[buttons(on, on, on, on, off, on)])  # -> graft(Support)
supp_2 = SupportKaramba3D(PosInd=move.Geometry, menu=[buttons(off, on, on, on, off, on)])  # -> graft(Support)
linetobeam = LineToBeamKaramba3D(Line=ln, CrossSection=cross_section, New=True, Remove=True, LimitDistance_m=0.005)  # -> Element, Points, Info
loads = LoadsKaramba3D(Vector=neg, LCase=0, mode="Uniform Line", menu=[buttons(on, off, off)])  # -> graft(Load)
assemble = AssembleModelKaramba3D(Elem=linetobeam.Element, Support=[supp, supp_2], Load=loads, LimitDistance_m=0.005)  # -> Model, Info, Mass_kg, CenterOfGravity
analyze = AnalyzeKaramba3D(Model=assemble.Model)  # -> CalculatedModel, MaximumDisplacement_cm, ResultingForceOfGravity_kN, ElasticEnergy_kNm
num = Number(flatten(move.Geometry))
num_2 = Number(flatten(analyze.MaximumDisplacement_cm))
num_3 = Number(flatten(random_3))
num_4 = Number(flatten(random_2))
beam_length_m = Panel(num)
displacement_cm = Panel(num_2)
load_kn_m = Panel(num_3)
height_width_cm = Panel(num_4)
number_slider_3 = Slider(20, range=0..20)  # disabled
num_5 = Number(graft(beam_length_m))
num_6 = Number(graft(displacement_cm))
num_7 = Number(graft(load_kn_m))
num_8 = Number(graft(height_width_cm))
expression = Expression(x=num_5, Expression="Format(\"{0:0.0000001}\",x)")
expression_2 = Expression(x=num_6, Expression="Format(\"{0:0.0000001}\",x)")
expression_3 = Expression(x=num_7, Expression="Format(\"{0:0.0000001}\",x)")
expression_4 = Expression(x=num_8, Expression="Format(\"{0:0.0000001}\",x)")
item = ListItem(List=flatten(assemble.Model), Index=number_slider_3, Wrap=True)  # disabled
beamview = BeamViewKaramba3D(Model=item)  # -> Model, MeshesOfRenderedBeams, DeformedBeamAxes, LegendColors, LegendTags; disabled
modelview = ModelViewKaramba3D(Model=item, ResultFactors=1, ResultCase=-1)  # -> Model, DeformedMesh, DeformedAxes, DeformedModel; disabled

# ----
# EI
panel = Panel("4")  # disabled
pow = Power(A=num_8, B=panel)  # disabled
panel_2 = Panel("12")  # disabled
division = Division(A=pow, B=panel_2)  # disabled
panel_3 = Panel("2100000")  # disabled
multiplication = Multiplication(A=division, B=panel_3)  # disabled

# ----
# Theoretical solution
panel_4 = Panel("100")  # disabled
multiplication_2 = Multiplication(A=num_5, B=panel_4)  # disabled
panel_5 = Panel("5")  # disabled
panel_6 = Panel("4")  # disabled
multiplication_3 = Multiplication(A=num_7, B=panel_5)  # disabled
pow_2 = Power(A=multiplication_2, B=panel_6)  # disabled
panel_7 = Panel("384")  # disabled
multiplication_4 = Multiplication(A=multiplication_3, B=pow_2)  # disabled
multiplication_5 = Multiplication(A=multiplication, B=panel_7)  # disabled
division_2 = Division(A=multiplication_4, B=multiplication_5)  # -> flatten(Result); disabled

merge = Merge(Data1=expression, Data2=expression_4, Data3=expression_3, Data4=expression_2)
write2csv = Write2csv(Data=merge, Filepath="insert filepath")
panel_8 = Panel(division_2)  # disabled

# ----
# Error in prosentage
# wtf: Solved. Estimate value is aprox. 2.4% too high at every iteration.. hmm?
# This was because the same seed was used to genrate random numbers for all three variables...
num_9 = Number(division_2)  # disabled
num_10 = Number(displacement_cm)  # disabled
subtraction = Subtraction(A=num_10, B=num_9)  # disabled
abs = Absolute(Value=subtraction)  # disabled
division_3 = Division(A=subtraction, B=num_10)  # disabled
multiplication_6 = Multiplication(A=division_3, B=100)  # disabled
panel_9 = Panel(multiplication_6)  # disabled
sort_list = SortList(Keys=multiplication_6, ValuesValuesA=multiplication_6)  # -> Keys, ValuesValuesA; disabled
list_item = ListItem(List=sort_list.ValuesValuesA, Index=0, Wrap=True)  # -> Item1, Item; disabled
panel_10 = Panel(list_item.Item1)  # disabled
