# Grasshopper definition generate data.gh (Grasshopper 1.0.7)
# plug-ins: karambaGH, Write2csv

number_slider = Slider(10, range=1..10000)
number_slider_2 = Slider(0, range=0..100)
dom = ConstructDomain(DomainStart=Slider(-4, range=-4..4), DomainEnd=Slider(4, range=-4..4))
series = Series(Start=Slider(-5, range=-5..5), Step=number_slider_2, Count=number_slider)
series_2 = Series(Start=Slider(5, range=-5..5), Step=number_slider_2, Count=number_slider)
dom_2 = ConstructDomain(DomainStart=Slider(1, range=1..6), DomainEnd=Slider(6, range=1..6))
random = Random(Range=dom, Number=number_slider, Seed=Slider(3, range=1..9))
random_2 = Random(Range=dom_2, Number=number_slider, Seed=Slider(4, range=1..9))
pt = ConstructPoint(XCoordinate=series, YCoordinate=0, ZCoordinate=0)
pt_2 = ConstructPoint(XCoordinate=series_2, YCoordinate=0, ZCoordinate=0)
pt_3 = ConstructPoint(XCoordinate=random, YCoordinate=0, ZCoordinate=random_2)
merge = Merge(Data1=graft(pt), Data2=graft(pt_3), Data3=graft(pt_2))
intcrv = Interpolate(Vertices=merge, Degree=3, Periodic=False, KnotStyle=1)  # -> Curve, Length, Domain
branch = TreeBranch(Tree=simplify(intcrv.Curve), Path=Slider(0, range=0..10000), MaintainPaths=True)
divide = DivideCurve(Curve=intcrv.Curve, Count=Slider(10, range=2..10), Kinks=False)  # -> Points, Tangents, Parameters
pline = PolyLine(Vertices=divide.Points, Closed=False)
number_slider_3 = Slider(4.5, range=3..10)
explode = Explode(Curve=pline, Recursive=True)  # -> Segments, Vertices
panel = Panel("""-1
0""")
cull_i = CullIndex(List=explode.Vertices, Indices=panel, Wrap=True)
cross_section = CrossSectionKaramba3D(
    FamilyNameOfCrossSection="DefaultCroSec",
    Material=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,
    Height_cm=number_slider_3,
    UpperFlangeWidth_cm=number_slider_3,
    LowerFlangeWidth_cm=number_slider_3,
    mode="Trapezoid")
pt_4 = Point("-5,0,0")
pt_5 = Point("5,0,0")
free_nodes = Point(cull_i)
bars = Line(explode.Segments)
suppts = Point([pt_4, pt_5])
Z = UnitZ(Factor=1)
supp = SupportKaramba3D(PosInd=suppts, menu=[buttons(on, on, on, on, off, on)])
linetobeam = LineToBeamKaramba3D(Line=bars, New=True, Remove=True, LimitDistance_m=0.005)  # -> Element, Points, Info
loads = LoadsKaramba3D(Vector=Z, LCase=0, mode="Gravity")
assemble = AssembleModelKaramba3D(Point=free_nodes, Elem=linetobeam.Element, Support=supp, Load=loads, CrossSection=cross_section, LimitDistance_m=0.005)  # -> Model, Info, Mass_kg, CenterOfGravity
analyze = AnalyzeKaramba3D(Model=assemble.Model)  # -> CalculatedModel, MaximumDisplacement_cm, ResultingForceOfGravity_kN, ElasticEnergy_kNm
panel_2 = Panel("C:\Users\ies3\OneDrive\Documents\Skule\10. Semester\Master\GH\dataset")
x = Number(simplify(graft(random)))
y = Number(simplify(graft(random_2)))
displ = Number(simplify(analyze.MaximumDisplacement_cm))
num = Number(flatten(x))
num_2 = Number(flatten(y))
num_3 = Number(flatten(displ))
merge_2 = Merge(Data1=x, Data2=y, Data3=displ)
write2csv = Write2csv(Data=merge_2, Filepath=panel_2)
c_script = CSharpScript(x=num, y=num_2, displ=num_3)  # -> out, A; inputs x: list of Double, y: list of Double, displ: list of Double, dir: String
# ---------- c_script: C# ----------
    string[] lines = {};
    for (int i = 0; i < x.Count; i++)
    {
      string[] line = {x[i].ToString() + y[i].ToString() + displ[i].ToString()};
      
    }
# ---------- end c_script ----------
panel_3 = Panel(merge_2)
panel_4 = Panel(c_script.out)
