# Grasshopper definition nurbs-karamba.gh (Grasshopper 1.0.7)
# plug-ins: karambaGH

crv = Curve(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)
crv_2 = Curve(<curve referenced from the Rhino model>)
divide = DivideCurve(Curve=crv_2, Count=Slider(8, range=4..20), Kinks=False)  # -> Points, Tangents, Parameters
item = ListItem(List=divide.Points, Index=0, Wrap=True)  # -> Item1, Item
pline = PolyLine(Vertices=divide.Points, Closed=False)
explode = Explode(Curve=pline, Recursive=True)  # -> Segments, Vertices
panel = Panel("""-1
0""")
cull_i = CullIndex(List=explode.Vertices, Indices=panel, Wrap=True)
number_slider = Slider(7.5, range=5..10)
supp = SupportKaramba3D(PosInd=item.Item1, menu=[buttons(on, on, on, on, off, on)])
supp_2 = SupportKaramba3D(PosInd=item.Item, menu=[buttons(on, on, on, on, off, on)])
Z = UnitZ(Factor=Slider(0.1, range=0.1..1))
linetobeam = LineToBeamKaramba3D(Line=explode.Segments, New=True, Remove=True, LimitDistance_m=0.005)  # -> Element, Points, Info
neg = Negative(Value=Z)
cross_section = CrossSectionKaramba3D(
    FamilyNameOfCrossSection="DefaultCroSec",
    Material=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,
    Height_cm=number_slider,
    UpperFlangeWidth_cm=number_slider,
    LowerFlangeWidth_cm=number_slider,
    mode="Trapezoid")
loads = LoadsKaramba3D(Vector=neg, LCase=0, mode="Gravity")
assemble = AssembleModelKaramba3D(
    Point=cull_i,
    Elem=linetobeam.Element,
    Support=[supp, supp_2],
    Load=loads,
    CrossSection=cross_section,
    LimitDistance_m=0.005)  # -> Model, Info, Mass_kg, CenterOfGravity
analyze = AnalyzeKaramba3D(Model=assemble.Model)  # -> CalculatedModel, simplify(MaximumDisplacement_cm), ResultingForceOfGravity_kN, ElasticEnergy_kNm
modelview = ModelViewKaramba3D(Model=analyze.CalculatedModel, ResultFactors=1, ResultCase=-1)  # -> Model, DeformedMesh, DeformedAxes, DeformedModel
beamview = BeamViewKaramba3D(Model=analyze.CalculatedModel)  # -> Model, MeshesOfRenderedBeams, DeformedBeamAxes, LegendColors, LegendTags
panel_2 = Panel(analyze.MaximumDisplacement_cm)
